# Grasshopper definition solarRadiation.gh (Grasshopper 1.0.7)
# Copyright: TAKAGI SHUTA OFFICE LLC.

# ---- group: Ladybug起動
# step01. ジオメトリを入力
ladybug = Ladybug_Ladybug()  # -> Vviiiiiiiiiizzz; plug-in component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

# ----
geo_周辺建物サンプル = Geometry(<brep referenced from the Rhino model>)
geo_解析対象サンプル = Geometry(<brep referenced from the Rhino model>)
geo = Geometry()

# ----
# step01-1. 建物のジオメトリを入力
# step01-2. 窓面のジオメトリを入力
# step01-3. 周辺環境のジオメトリを入力
# step01-4. ルーバーのジオメトリを入力
geo_2 = Geometry()

preview = CustomPreview(Geometry=geo_周辺建物サンプル, Material=ColourSwatch(SwatchColor=RGB(120, 120, 120)))

# ---- group: スカイマトリックス指定 / epwファイル指定
# step02. 気象データを入力
# 注）今はTaipeiのデータを使用していますが、
# ARUP在籍時に共有させていただいた
# 気象データをお使いください
path = FilePath("C:\Users\katsu\Documents\development\design-engineering-class\class8_ladybug\data\epw\TWN_Taipei.466960_IWEC\TWN_Taipei.466960_IWEC.epw")

# ---- group: スカイマトリックス指定 / ON / OFF
toggle = BooleanToggle(True)

# ---- group: 凡例設定
最小値 = Slider(0, range=0..2000)
最大値 = Slider(1500, range=0..2000)
legendpar = Ladybug_LegendParameters(lowBound=最小値, highBound=最大値)  # -> legendPar; plug-in component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

# ---- group: スカイマトリックス指定
gencumulativeskymtx = Ladybug_GenCumulativeSkyMtx(epwFile=path, skyDensity=0, useOldRes=True, runIt=toggle)  # -> readMe, cumulativeSkyMtx; plug-in component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
selectskymtx = Ladybug_selectSkyMtx(cumulativeSkyMtx=gencumulativeskymtx.cumulativeSkyMtx, removeDiffuse=False, removeDirect=False)  # -> readMe, selectedSkyMtx; plug-in component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

# ---- group: 北の向き (Y軸正方向が0)
# step03. 計算開始
度 = Slider(0, range=0..359)

# ---- group: ON / OFF
toggle_2 = BooleanToggle(True)

# ----
m = Slider(0.01, range=0.01..1)
m_2 = Slider(0.5, range=0.01..1)

radiationanalysis = Ladybug_RadiationAnalysis(
    north=度,
    geometry=flatten(geo_解析対象サンプル),
    context=flatten([geo, geo_2, geo_周辺建物サンプル]),
    gridSize=m_2,
    disFromBase=m,
    selectedSkyMtx=flatten(selectskymtx.selectedSkyMtx),
    legendPar=flatten(legendpar),
    parallel=True,
    runIt=toggle_2)  # -> readMe, contextMesh, analysisMesh, testPts, testVec, port, radiationResult, radiationMesh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; plug-in component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
プレビューについて = Panel("輪郭線が表示されている場合は、Grasshopperの[Display]メニューから、[Preview Mesh Edges]をOFFにする。")

preview_2 = CustomPreview(
    Geometry=[radiationanalysis.radiationMesh, radiationanalysis.radiationLegend],
    Material=ColourSwatch(SwatchColor=RGB(0, 0, 0)))

# ----
# step04. 窓のSC値
sc = Slider(0.45, range=0..1)
num = Number(0.86)
multiplication = Multiplication(A=sc, B=num)
multiplication_2 = Multiplication(A=radiationanalysis.totalRadiation, B=multiplication)
int = Integer(1000)
division = Division(A=multiplication_2, B=int)

# ----
# step05. 窓からの入射日射量合計が
# 9MWhを超えないようにルーバー、
# 窓面積、SC値を調整してください
窓からの入射日射量_mwh = Panel(division)
