# Grasshopper definition python説明.gh (Grasshopper 1.0.7)

# ----
# Point2点をつなげてcurveにする
# AddCurveを使用
pt = Point(Point(35.70199421, 2.470485068, 0))
pt_2 = Point(Point(34.2879281, -14.95140996, 0))
merge = Merge(Data1=pt, Data2=pt_2)
python = GhPythonScript(points=merge)  # -> out, a; inputs points: list
# ---------- python: Python ----------
__author__ = "katsu"
__version__ = "2022.04.20"

import rhinoscriptsyntax as rs

#参照リンク https://developer.rhino3d.com/api/RhinoScriptSyntax/#curve-AddCurve
guid = rs.AddCurve(points)

a=guid
# ---------- end python ----------

# ----
# 2つのbrepが交差している部分の面積を計算する
# OffsetSurface, SurfaceAreaを使用
brep = Brep(<brep referenced from the Rhino model>)
brep_2 = Brep(<brep referenced from the Rhino model>)
python_2 = GhPythonScript(x=brep, y=brep_2)  # -> out, a
# ---------- python_2: Python ----------
__author__ = "katsu"
__version__ = "2022.04.20"

import rhinoscriptsyntax as rs

#参照リンク https://developer.rhino3d.com/api/RhinoScriptSyntax/#surface-OffsetSurface
guid = rs.IntersectBreps(x,y)

area=rs.CurveArea(guid)

a=area
# ---------- end python_2 ----------
panel = Panel(python_2.a)

python_3 = GhPythonScript(point1=pt, point2=pt_2)  # -> out, a
# ---------- python_3: Python ----------
__author__ = "katsu"
__version__ = "2022.04.20"

import rhinoscriptsyntax as rs

#参照リンク https://developer.rhino3d.com/api/RhinoScriptSyntax/#curve-AddCurve
guid = rs.AddCurve([point1,point2])

a=guid
# ---------- end python_3 ----------
ln = Line(StartPoint=pt, EndPoint=pt_2)
python_4 = GhPythonScript()  # -> Out, A
