# Grasshopper definition データツリー説明.gh (Grasshopper 1.0.7)
# plug-ins: Heteroptera

# ----
# データに構造を持たせる意味
# それぞれの室(polysurface、もしくはextrusion)に対してDeconstructBrepを行う
brep = Brep([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])
debrep = DeconstructBrep(Brep=brep)  # -> Faces, Edges, Vertices

# ----
# 室ごとに面を処理する(オリジナルと同じ）
# 結論: データ構造は処理の目的に応じて使い分ける
number_slider = Slider(30, range=0..100)
debrep_2 = DeconstructBrep(Brep=brep)  # -> simplify(Faces), Edges, Vertices
X = UnitX(Factor=number_slider)
move = Move(Geometry=debrep_2.Faces, Motion=X)  # -> Geometry, Transform
branch = TreeBranch(Tree=debrep_2.Faces, Path="{1}", MaintainPaths=True)
branch_2 = TreeBranch(Tree=move.Geometry, Path="{0}", MaintainPaths=True)
panel = Panel(branch_2)
center = Center(Geometric=branch_2)  # -> Center, Dimension
scale = Scale(Geometry=branch_2, Center=center.Center, Factor=0.5)  # -> Geometry, Transform

# ----
# スタート地点のデータ構造
panel_2 = Panel(debrep.Faces)
# データ構造の用途（例）
viewer = ParamViewer(panel_2)

# ----
# データツリーに関する説明
# (Grasshopperの場合はデータツリーという形）
# 部屋が3つ
panel_3 = Panel(brep)

# ----
# simplify
# =>不必要な入れ子を取り除く
simplify = SimplifyTree(Tree=panel_2, Front=False)
viewer_2 = ParamViewer(simplify)
# データツリーに対する処理
# まずはflattenとsimplifyができていればよい。たいていのケースでは、Graftでできることはflattenでもできる。
panel_4 = Panel(simplify)

# ----
# 各部屋を構成している面（壁、屋根、床）は6
panel_5 = Panel(debrep.Faces)

# ----
# flatten
# =>入れ子の構造を完全に取り除く
flatten = FlattenTree(Tree=panel_2, Path="{0}")
viewer_3 = ParamViewer(flatten)
panel_6 = Panel(flatten)

# ----
# それぞれの面に対して処理をする
number_slider_2 = Slider(60, range=0..100)
debrep_3 = DeconstructBrep(Brep=brep)  # -> flatten(Faces), Edges, Vertices
X_2 = UnitX(Factor=number_slider_2)
move_2 = Move(Geometry=debrep_3.Faces, Motion=X_2)  # -> Geometry, Transform
item = ListItem(List=move_2.Geometry, Index=0, Wrap=True)
center_2 = Center(Geometric=item)  # -> Center, Dimension
scale_2 = Scale(Geometry=item, Center=center_2.Center, Factor=0.5)  # -> Geometry, Transform

# ----
# Graft
# =>さらにもう一階層枝分かれさせる
graft = GraftTree(Tree=panel_2, IncludeEmptyLists=True, IncludeNullItems=True)
viewer_4 = ParamViewer(graft)
panel_7 = Panel(graft)

# ----
# データの型に関する説明
# 各コンポーネントのinput,outputをしっかり確認することが大事
# inputとしてはBrepが必要
# outputとしてはsurface,curve,pointが書き出される
brep_2 = Brep([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])
debrep_4 = DeconstructBrep()  # -> Faces, Edges, Vertices
srf = Surface()
crv = Curve()
pt = Point()
