# Grasshopper definition 220512.gh (Grasshopper 1.0.7)
# plug-ins: Karamba3D

X = UnitX(Factor=Slider(8, range=0..10))
pt = ConstructPoint(XCoordinate=Slider(0, range=0..10), YCoordinate=0, ZCoordinate=0)
division = Division(A=X, B=Slider(2, range=0..10))
panel = Panel("20100")
move = Move(Geometry=pt, Motion=X)  # -> Geometry, Transform
move_2 = Move(Geometry=pt, Motion=division)  # -> Geometry, Transform
matprops = MaterialPropertiesKaramba3D(
    FamilyOfMaterial="Steel",
    Name="S235",
    YoungsModulus_kN_cm2=Slider(23487, range=10000..50000),
    InPlaneShearModulus_kN_cm2=8076,
    TransverseShearModulus_kN_cm2=8076,
    SpecificWeight_kN_m3=78.5,
    CoefficientOfThermalExpansion_1_C=1.2e-05,
    TensileStrength_kN_cm2=23.5,
    CompressiveStrength_kN_cm2=-23.5,
    StrengthHypothesis="MISES",
    mode="Isotrop")
neg = Negative(Value=Slider(99, range=0..100))
ln = Line(StartPoint=pt, EndPoint=move_2.Geometry)
ln_2 = Line(StartPoint=move_2.Geometry, EndPoint=move.Geometry)
Z = UnitZ(Factor=neg)
cross_section = CrossSectionKaramba3D(
    FamilyNameOfCrossSection="DefaultCroSec",
    Material=matprops,
    Height_cm="40",
    UpperFlangeWidth_cm="20",
    LowerFlangeWidth_cm="20",
    UpperFlangeThickness_cm="1.3",
    LowerFlangeThickness_cm="1.3",
    WebThickness_cm="0.8",
    FilletRadius_cm=0,
    mode="I")
supp = SupportKaramba3D(PosInd=move.Geometry, menu=[buttons(off, on, on, on, off, off)])
linetobeam = LineToBeamKaramba3D(
    Line=[ln, ln_2],
    New=True,
    Remove=True,
    LimitDistance_m=0.005,
    Bending=True,
    SetBucklingLength=True,
    ToPolylineMaxAngle=0.03,
    ToPolylineTolerance=0.01,
    ToPolylineMinEdgeLength=0.25)  # -> Element, Points, Info
supp_2 = SupportKaramba3D(PosInd=pt, menu=[buttons(on, on, on, on, off, off)])
beam_loads = BeamLoadsKaramba3D(LoadCase="0", ForceVector=Z, TStart=0, TEnd=1, mode="Block", menu=[buttons(on, off, off)])
assemble = AssembleModelKaramba3D(Elem=linetobeam.Element, Support=[supp_2, supp], Load=beam_loads, CrossSection=cross_section, LimitDistance_m=0.005)  # -> Model, Info, Mass_kg, CenterOfGravity, LoadCaseNames
disassemble = DisassembleCrossSectionKaramba3D(CroSec=cross_section)  # -> CrossSection, FamilyNameOfCrossSection, TypeNameOfCrossSection, ElemIdentifiers, Color, Material, LocalEccentricity_cm, Heights_cm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
analyze = AnalyzeKaramba3D(Model=assemble.Model)  # -> CalculatedModel, MaximumDisplacement_cm, ResultingForceOfGravity_kN, ElasticEnergyChange_kNm
panel_2 = Panel(disassemble.Iyy_cm4)
panel_3 = Panel(disassemble.Area_cm2)
panel_4 = Panel(analyze.MaximumDisplacement_cm)
beamview = BeamViewKaramba3D(Model=analyze.CalculatedModel)  # -> Model, MeshesOfRenderedBeams, DeformedBeamAxes, LegendColors, LegendTags
