# Grasshopper definition 220519.gh (Grasshopper 1.0.7)
# plug-ins: Karamba3D

matprops = MaterialPropertiesKaramba3D(
    FamilyOfMaterial="Steel",
    Name="S235",
    YoungsModulus_kN_cm2="20500",
    InPlaneShearModulus_kN_cm2=8076,
    TransverseShearModulus_kN_cm2=8076,
    SpecificWeight_kN_m3=78.5,
    CoefficientOfThermalExpansion_1_C=1.2e-05,
    TensileStrength_kN_cm2=23.5,
    CompressiveStrength_kN_cm2=-23.5,
    StrengthHypothesis="MISES",
    mode="Isotrop")
python = GhPythonScript(L=Slider(20, range=20..50), H=Slider(10, range=10..25), n=Slider(20, range=0..100))  # -> out, pti, pt1, pt2, elem
# ---------- python: Python ----------
__author__ = "katsu"
__version__ = "2022.05.19"

import rhinoscriptsyntax as rs

ptA = (0,0,0)
ptB = (L,0,0)
ptC = (L/2,0,H)

arc = rs.AddArc3Pt(ptA,ptB,ptC)

pti = rs.DivideCurve(arc,n)

pt1=pti[0]
pt2=pti[-1]

elem = []

for i in range((len(pti)-1)):
    #print (i)
    elem.append(rs.AddLine(pti[i],pti[i+1]))
# ---------- end python ----------
Z = UnitZ(Factor="-40")
cross_section = CrossSectionKaramba3D(
    FamilyNameOfCrossSection="DefaultCroSec",
    Material=matprops,
    Diameter_cm="40",
    WallThickness_cm="1.2",
    mode="Circular Hollow")
supp = SupportKaramba3D(PosInd=[python.pt1, python.pt2], menu=[buttons(on, on, on, on, off, on)])
loads = LoadsKaramba3D(ForceVector=Z, Local=False, PosInd=python.pti, LCase="0", mode="Point")
linetobeam = LineToBeamKaramba3D(
    Line=python.elem,
    New=True,
    Remove=True,
    LimitDistance_m=0.005,
    Bending=True,
    SetBucklingLength=True,
    ToPolylineMaxAngle=0.03,
    ToPolylineTolerance=0.01,
    ToPolylineMinEdgeLength=0.25)  # -> Element, Points, Info
disassemble = DisassembleCrossSectionKaramba3D(CroSec=cross_section)  # -> CrossSection, FamilyNameOfCrossSection, TypeNameOfCrossSection, ElemIdentifiers, Color, Material, LocalEccentricity_cm, Heights_cm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
assemble = AssembleModelKaramba3D(Elem=linetobeam.Element, Support=supp, Load=loads, CrossSection=cross_section, LimitDistance_m=0.005)  # -> Model, Info, Mass_kg, CenterOfGravity, LoadCaseNames
analyze = AnalyzeKaramba3D(Model=assemble.Model)  # -> CalculatedModel, MaximumDisplacement_cm, ResultingForceOfGravity_kN, ElasticEnergyChange_kNm
modelview = ModelViewKaramba3D(Model=analyze.CalculatedModel, ResultFactors=1, ResultCase=-1)  # -> Model, DeformedMesh, DeformedAxes, DeformedModel
b_forces = BeamForcesKaramba3D(AnalyzedModel=modelview.Model, Ts=[0, 1])  # -> AnalyzedModel, simplify(NormalForce_kN), ShearForceVz_kN, ShearForceVy_kN, BendingMomentMt_kNm, simplify(BendingMomentMy_kNm), BendingMomentMz_kNm
beamview = BeamViewKaramba3D(Model=modelview.Model)  # -> Model, MeshesOfRenderedBeams, DeformedBeamAxes, LegendColors, LegendTags
panel = Panel(b_forces.NormalForce_kN)
panel_2 = Panel(b_forces.BendingMomentMy_kNm)
eval = Evaluate(F="abs(N/A)+abs(M*100/Z)", N=b_forces.NormalForce_kN, M=b_forces.BendingMomentMy_kNm, A="146.3", Z="1378")  # -> flatten(r)
panel_3 = Panel(eval)
bnd = Bounds(Numbers=eval)
