# Grasshopper definition 220526.gh (Grasshopper 1.0.7)
# plug-ins: Karamba3D

matprops = MaterialPropertiesKaramba3D(
    FamilyOfMaterial="Steel",
    Name="S235",
    YoungsModulus_kN_cm2="20500",
    InPlaneShearModulus_kN_cm2=8076,
    TransverseShearModulus_kN_cm2=8076,
    SpecificWeight_kN_m3=78.5,
    CoefficientOfThermalExpansion_1_C=1.2e-05,
    TensileStrength_kN_cm2=23.5,
    CompressiveStrength_kN_cm2=-23.5,
    StrengthHypothesis="MISES",
    mode="Isotrop")

Z = UnitZ(Factor="-1")
Z_2 = UnitZ(Factor="-30")
beam_loads = BeamLoadsKaramba3D(BeamIdentifier="bu", LoadCase="0", ForceVector=Z_2, TStart=0, TEnd=1, mode="Block", menu=[buttons(on, off, off)])
loads = LoadsKaramba3D(Vector=Z, LCase="0", mode="Gravity")

galapagos = Galapagos(fitness=eval, gene=genes)

# ----
# 上弦材
panel = Panel("20")
pt = ConstructPoint(XCoordinate=0, YCoordinate=0, ZCoordinate=0)
pt_2 = ConstructPoint(XCoordinate=panel, YCoordinate=0, ZCoordinate=0)
ln = Line(StartPoint=pt, EndPoint=pt_2)

divide = DivideCurve(Curve=ln, Count="3", Kinks=False)  # -> Points, Tangents, Parameters

shatter = Shatter(Curve=ln, Parameters=divide.Parameters)

# ----
# 下弦材
panel_2 = Panel("2.5")
neg = Negative(Value=panel_2)
Z_3 = UnitZ(Factor=neg)
move = Move(Geometry=divide.Points, Motion=Z_3)  # -> Geometry, Transform
move_2 = Move(Geometry=shatter, Motion=Z_3)  # -> Geometry, Transform

上弦材節点 = Point(divide.Points)
下弦材節点 = Point(move.Geometry)

# ----
# トラス材
genes = GenePool(Decimals=0, Maximum=1, Minimum=0, Value=[0, 0, 0, 1, 0, 0, 0, 1, 0, 0, 0, 0, 1, 1, 0, 1])
ln_2 = Line(StartPoint=graft(上弦材節点), EndPoint=下弦材節点)  # -> flatten(Line)
dispatch = Dispatch(List=ln_2, DispatchPattern=genes)  # -> ListA, ListB
トラス材 = Line(dispatch.ListB)

上弦材 = Line(shatter)
下弦材 = Line(move_2.Geometry)
panel_3 = Panel(dispatch.ListB)
トラス材_2 = Line(dispatch.ListA)
panel_4 = Panel(dispatch.ListA)

cross_section = CrossSectionKaramba3D(
    FamilyNameOfCrossSection="DefaultCroSec",
    Material=matprops,
    Diameter_cm="26.74",
    WallThickness_cm="0.93",
    mode="Circular Hollow")
linetobeam = LineToBeamKaramba3D(
    Line=トラス材,
    CrossSection=cross_section,
    New=True,
    Remove=True,
    LimitDistance_m=0.005,
    Bending=Toggle(False),
    SetBucklingLength=True,
    ToPolylineMaxAngle=0.03,
    ToPolylineTolerance=0.01,
    ToPolylineMinEdgeLength=0.25)  # -> Element, Points, Info

cross_section_2 = CrossSectionKaramba3D(
    FamilyNameOfCrossSection="DefaultCroSec",
    Material=matprops,
    Diameter_cm="40",
    WallThickness_cm="1.9",
    mode="Circular Hollow")
linetobeam_2 = LineToBeamKaramba3D(
    Line=下弦材,
    CrossSection=cross_section_2,
    New=True,
    Remove=True,
    LimitDistance_m=0.005,
    Bending=True,
    SetBucklingLength=True,
    ToPolylineMaxAngle=0.03,
    ToPolylineTolerance=0.01,
    ToPolylineMinEdgeLength=0.25)  # -> Element, Points, Info
linetobeam_3 = LineToBeamKaramba3D(
    Line=上弦材,
    Identifier="bu",
    CrossSection=cross_section_2,
    New=True,
    Remove=True,
    LimitDistance_m=0.005,
    Bending=True,
    SetBucklingLength=True,
    ToPolylineMaxAngle=0.03,
    ToPolylineTolerance=0.01,
    ToPolylineMinEdgeLength=0.25)  # -> Element, Points, Info

item = ListItem(List=下弦材節点, Index="0", Wrap=True)
supp = SupportKaramba3D(PosInd=[pt, item], menu=[buttons(on, on, on, on, on, on)])
assemble = AssembleModelKaramba3D(
    Elem=flatten([linetobeam_3.Element, linetobeam_2.Element, linetobeam.Element]),
    Support=flatten(supp),
    Load=flatten([beam_loads, loads]),
    LimitDistance_m=0.005)  # -> Model, Info, Mass_kg, CenterOfGravity, LoadCaseNames
panel_5 = Panel(assemble.Mass_kg)
analyze = AnalyzeKaramba3D(Model=assemble.Model)  # -> CalculatedModel, MaximumDisplacement_cm, ResultingForceOfGravity_kN, ElasticEnergyChange_kNm
panel_6 = Panel(analyze.MaximumDisplacement_cm)
modelview = ModelViewKaramba3D(Model=analyze.CalculatedModel, ResultFactors=1, ResultCase=-1)  # -> Model, DeformedMesh, DeformedAxes, DeformedModel
eval = Evaluate(F="if(x<=20,y,y*2)", x=analyze.MaximumDisplacement_cm, y=assemble.Mass_kg)
beamview = BeamViewKaramba3D(Model=modelview.Model)  # -> Model, MeshesOfRenderedBeams, DeformedBeamAxes, LegendColors, LegendTags
panel_7 = Panel(eval)
